# Grasshopper definition tests.gh (Grasshopper 1.0.8)
# Copyright: GNU Lesser General Public License Version 3
# plug-ins: RhinoCodePluginGH, Hops, semio

list = ValueList({"Typ(Base)": 0, "Typ(Base,Blob)": 1, "Typ(Bridge)": 2, "Typ(Capsule,\)": 3, "Typ(Capsule,/)": 4, "Typ(Capsule,p)": 5, "Typ(Capsule,q)": 6, "Typ(Capsule,L)": 7, "Typ(Capsule,J)": 8, "Typ(Capsule,z)": 9, "Typ(Capsule,s)": 10, "Typ(Cylindric Capital)": 11, "Typ(Cylindric Tambour)": 12, "Typ(Cylindric Tambour,First Storey)": 13, "Typ(Cylindric Tambour,Last Storey)": 14, "Typ(Cylindric Tambour,Single Storey)": 15, "Typ(Tambour)": 16, "Typ(Tambour,First Storey)": 17, "Typ(Tambour,Last Storey)": 18, "Typ(Tambour,Single Storey)": 19, "Typ(Ellipsoid Capsule,\)": 20, "Typ(Ellipsoid Capsule,/)": 21, "Typ(Ellipsoid Capsule,p)": 22, "Typ(Ellipsoid Capsule,q)": 23, "Typ(Ellipsoid Capsule,L)": 24, "Typ(Ellipsoid Capsule,J)": 25, "Typ(Ellipsoid Capsule,z)": 26, "Typ(Ellipsoid Capsule,s)": 27, "Typ(Capital)": 28}, selected=["Typ(Capsule,\)", "Typ(Capsule,/)", "Typ(Capsule,p)", "Typ(Capsule,q)", "Typ(Capsule,L)", "Typ(Capsule,J)", "Typ(Capsule,z)", "Typ(Capsule,s)", "Typ(Ellipsoid Capsule,\)", "Typ(Ellipsoid Capsule,/)", "Typ(Ellipsoid Capsule,p)", "Typ(Ellipsoid Capsule,q)", "Typ(Ellipsoid Capsule,L)", "Typ(Ellipsoid Capsule,J)", "Typ(Ellipsoid Capsule,z)", "Typ(Ellipsoid Capsule,s)"])
list_2 = ValueList({"Typ(Base)": 0, "Typ(Base,Blob)": 1, "Typ(Bridge)": 2, "Typ(Capsule,\)": 3, "Typ(Capsule,/)": 4, "Typ(Capsule,p)": 5, "Typ(Capsule,q)": 6, "Typ(Capsule,L)": 7, "Typ(Capsule,J)": 8, "Typ(Capsule,z)": 9, "Typ(Capsule,s)": 10, "Typ(Cylindric Capital)": 11, "Typ(Cylindric Tambour)": 12, "Typ(Cylindric Tambour,First Storey)": 13, "Typ(Cylindric Tambour,Last Storey)": 14, "Typ(Cylindric Tambour,Single Storey)": 15, "Typ(Tambour)": 16, "Typ(Tambour,First Storey)": 17, "Typ(Tambour,Last Storey)": 18, "Typ(Tambour,Single Storey)": 19, "Typ(Ellipsoid Capsule,\)": 20, "Typ(Ellipsoid Capsule,/)": 21, "Typ(Ellipsoid Capsule,p)": 22, "Typ(Ellipsoid Capsule,q)": 23, "Typ(Ellipsoid Capsule,L)": 24, "Typ(Ellipsoid Capsule,J)": 25, "Typ(Ellipsoid Capsule,z)": 26, "Typ(Ellipsoid Capsule,s)": 27, "Typ(Capital)": 28}, selected=["Typ(Base)", "Typ(Base,Blob)", "Typ(Bridge)", "Typ(Cylindric Capital)", "Typ(Cylindric Tambour)", "Typ(Cylindric Tambour,First Storey)", "Typ(Cylindric Tambour,Last Storey)", "Typ(Cylindric Tambour,Single Storey)", "Typ(Tambour)", "Typ(Tambour,First Storey)", "Typ(Tambour,Last Storey)", "Typ(Tambour,Single Storey)", "Typ(Capital)"])
ty = Type([null x29])
typ = ModelType(Type=ty)  # -> Type, Valid, Name, Description, Icon, Image, Variant, Unit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
panel = Panel(typ.Type)
panel_2 = Panel("""icons/base.svg
icons/base_blob.svg
icons/bridge.svg
icons/capsule_backslash.svg
icons/capsule_slash.svg
icons/capsule_p.svg
icons/capsule_q.svg
icons/capsule_L.svg
icons/capsule_J.svg
icons/capsule_z.svg
icons/capsule_s.svg
icons/cylindric-capital.svg
icons/cylindric-tambour.svg
icons/cylindric-tambour_first-storey.svg
icons/cylindric-tambour_last-storey.svg
icons/cylindric-tambour_single-storey.svg
icons/tambour.svg
icons/tambour_first-storey.svg
icons/tambour_last-storey.svg
icons/tambour_single-storey.svg
icons/ellipsoid-capsule_backslash.svg
icons/ellipsoid-capsule_slash.svg
icons/ellipsoid-capsule_p.svg
icons/ellipsoid-capsule_q.svg
icons/ellipsoid-capsule_L.svg
icons/ellipsoid-capsule_J.svg
icons/ellipsoid-capsule_z.svg
icons/ellipsoid-capsule_s.svg
icons/capital.svg""")
dir = Directory()  # -> D
# ---------- dir: C# ----------
#region Usings
using System;
using System.Linq;
using System.Collections;
using System.Collections.Generic;
using System.Drawing;
using System.IO;

using Rhino;
using Rhino.Geometry;

using Grasshopper;
using Grasshopper.Kernel;
using Grasshopper.Kernel.Data;
using Grasshopper.Kernel.Types;
#endregion

public class Script_Instance : GH_ScriptInstance
{
    private void RunScript(ref object D)
    {
        D = Path.GetDirectoryName(this.GrasshopperDocument.FilePath);
    }
}
# ---------- end dir ----------
sep = Separator()  # -> S
# ---------- sep: C# ----------
#region Usings
using System;
using System.Linq;
using System.Collections;
using System.Collections.Generic;
using System.Drawing;
using System.IO;

using Rhino;
using Rhino.Geometry;

using Grasshopper;
using Grasshopper.Kernel;
using Grasshopper.Kernel.Data;
using Grasshopper.Kernel.Types;
#endregion

public class Script_Instance : GH_ScriptInstance
{
    private void RunScript(ref object S)
    {
        S = Path.DirectorySeparatorChar;
    }
}
# ---------- end sep ----------
panel_3 = Panel("""base
blob-base
bridge
capital
capsule-with-balcony
capsule
cylindric-capital
cylindric-tambour
ellipsoid-capsule
tambour
trapezoid-capsule""")
dir_2 = Directory(D=dir)  # -> AP, Pa
# ---------- dir_2: Python ----------
#Component Information
#--------------------------------------------------------------------------------------------
if ghenv.Component.RunCount<2:
    #General
    #--------------------------------------------------------------------------------------------
    __author__ = "Ueli Saluz"
    __version__ = "2024.01.30"
    
    ghenv.Component.Name = "Directory"
    ghenv.Component.NickName = "Dir"
    ghenv.Component.Description = "Attributes of a directory."
    ghenv.Component.Message = "VER 1.0"
    ghenv.Component.Category = "Params"
    ghenv.Component.SubCategory = "Util"
    
    #Inputs
    #--------------------------------------------------------------------------------------------
    inputIndex=0
    
    ghenv.Component.Params.Input[inputIndex].Name = "Directory"
    ghenv.Component.Params.Input[inputIndex].NickName = "D"
    ghenv.Component.Params.Input[inputIndex].Description = "Path for a directory"
    inputIndex+=1
    
    #Outputs
    #--------------------------------------------------------------------------------------------
    outputIndex=0
    
    ghenv.Component.Params.Output[outputIndex].Name = "AbsolutePath"
    ghenv.Component.Params.Output[outputIndex].NickName = "AP"
    ghenv.Component.Params.Output[outputIndex].Description = "Absolute path."
    outputIndex+=1
    
    ghenv.Component.Params.Output[outputIndex].Name = "Parent"
    ghenv.Component.Params.Output[outputIndex].NickName = "Pa"
    ghenv.Component.Params.Output[outputIndex].Description = "Parent"
    outputIndex+=1

#Imports
#--------------------------------------------------------------------------------------------
from os.path import dirname, abspath, join
from os import sep, pardir

#Solver - Run with trees to enhance performance drastically
#--------------------------------------------------------------------------------------------
if __name__ == "__main__":
    AP = abspath(D)
    Pa = abspath(join(D, pardir))
# ---------- end dir_2 ----------
txt = Text(["icons/base.svg", "icons/base_blob.svg", "", "icons/capsule_backslash.svg", "icons/capsule_slash.svg", "icons/capsule_p.svg", "icons/capsule_q.svg", "icons/capsule_L.svg", "icons/capsule_J.svg", "icons/capsule_z.svg", "icons/capsule_s.svg", "icons/cylindric-capital.svg", "icons/cylindric-tambour.svg", "icons/cylindric-tambour_first-storey.svg", "icons/cylindric-tambour_last-storey.svg", "icons/cylindric-tambour_single-storey.svg", "icons/tambour.svg", "icons/tambour_first-storey.svg", "icons/tambour_last-storey.svg", "icons/tambour_single-storey.svg", "icons/ellipsoid-capsule_backslash.svg", "icons/ellipsoid-capsule_slash.svg", "icons/ellipsoid-capsule_p.svg", "icons/ellipsoid-capsule_q.svg", "icons/ellipsoid-capsule_L.svg", "icons/ellipsoid-capsule_J.svg", "icons/ellipsoid-capsule_z.svg", "icons/ellipsoid-capsule_s.svg", "icons/capital.svg"])
rep = ReplaceText(Text=typ.Icon, Find="\", Replace="/", RecursiveReplace=False)
dir_3 = Directory(D=dir_2.Pa)  # -> AP, Pa; same code as dir_2
# icons/base.svg
# icons/base_blob.svg
# icons/bridge.svg
# icons/capsule_backslash.svg
# icons/capsule_slash.svg
# icons/capsule_p.svg
# icons/capsule_q.svg
# icons/capsule_L.svg
# icons/capsule_J.svg
# icons/capsule_z.svg
# icons/capsule_s.svg
# icons/cylindric-capital.svg
# icons/cylindric-tambour.svg
# icons/cylindric-tambour_first-storey.svg
# icons/cylindric-tambour_last-storey.svg
# icons/cylindric-tambour_single-storey.svg
# icons/tambour.svg
# icons/tambour_first-storey.svg
# icons/tambour_last-storey.svg
# icons/tambour_single-storey.svg
# icons/ellipsoid-capsule_backslash.svg
# icons/ellipsoid-capsule_slash.svg
# icons/ellipsoid-capsule_p.svg
# icons/ellipsoid-capsule_q.svg
# icons/ellipsoid-capsule_L.svg
# icons/ellipsoid-capsule_J.svg
# icons/ellipsoid-capsule_z.svg
# icons/ellipsoid-capsule_s.svg
# icons/capital.svg
item = ListItem(Index=0, Wrap=True)
case = TextCase(Text=typ.Name, Culture=127)  # -> UpperCase, LowerCase
loc = ModelLocator(Group="door", Subgroup="entrance")  # -> Locator, Valid, Group, Subgroup
case_2 = TextCase(Text=typ.Name, Culture=127)  # -> UpperCase, LowerCase
panel_4 = Panel("""\
/
q
p
J
L
s
z""")
concat = Concatenate(FragmentA=dir_3.Pa, FragmentB=sep, FragmentC="examples")
panel_5 = Panel("""First Storey
Last Storey
Single Storey""")
graft = GraftTree(Tree=panel_4, IncludeEmptyLists=True, IncludeNullItems=True)
concat_2 = Concatenate(FragmentA="images/", FragmentB=case.LowerCase, FragmentC=".png")
concat_3 = Concatenate(FragmentA="images/", FragmentB=case_2.LowerCase, FragmentC=".png")
aut = ModelAuthor(Name="Ueli Saluz", Email="ueli.saluz@iek.uni-hannover.de")  # -> Author, Valid, Name, Email
concat_4 = Concatenate(FragmentA=concat, FragmentB=sep, FragmentC="metabolism")
concat_5 = Concatenate(FragmentA=concat_4, FragmentB=sep, FragmentC="types")
typ_2 = ModelType(Type=typ.Type, Icon=panel_2, Image=concat_3, Authors=aut.Author)  # -> Type, Valid, Name, Description, Icon, Image, Variant, Unit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
item_2 = ListItem(List=typ_2.Type, Index=list, Wrap=True)
item_3 = ListItem(List=typ_2.Type, Index=list_2, Wrap=True)
typ_3 = ModelType(Type=item_2)  # -> Type, Valid, Name, Description, Icon, Image, Variant, Unit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
typ_4 = ModelType(Type=item_3)  # -> Type, Valid, Name, Description, Icon, Image, Variant, Unit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
por = ModelPort(Port=typ_3.Ports)  # -> Port, Valid, Id, Point, Direction, Locators, Locators_2
loc_2 = ModelLocator(Locator=flatten(por.Locators))  # -> Locator, Valid, Group, Subgroup
por_2 = ModelPort(Port=typ_3.Ports, Locators=loc.Locator)  # -> Port, Valid, Id, Point, Direction, Locators, Locators_2
typ_5 = ModelType(Type=graft(item_2), Ports=por_2.Port)  # -> Type, Valid, Name, Description, Icon, Image, Variant, Unit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
graft_2 = GraftTree(Tree=panel_5, IncludeEmptyLists=True, IncludeNullItems=True)
concat_6 = Concatenate(FragmentA=concat_5, FragmentB=sep, FragmentC=panel_3, FragmentD=".gh")
ty_2 = Type(flatten(typ_5.Type))
item_4 = ListItem(List=concat_6, Index=0, Wrap=True)  # -> Item, Item1, Item2, Item3, Item4, Item5, Item6, Item7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
merge = Merge(Data1=typ_4.Type, Data2=ty_2)
toggle = BooleanToggle(True)
hops = Hops(
    _Path=item_4.Item,
    _Enabled=toggle,
    CacheResultsInMemory=True,
    CacheSolveResults=True,
    RemoteDefinitionLocation="C:\git\semio\examples\metabolism\types\base.gh",
    RemoteSolveVersion=(0, 1, 0),
    ShowInput_Enabled=True,
    ShowInput_Path=True,
    SynchronousSolve=False)
hops_2 = Hops(
    _Path=item_4.Item1,
    _Enabled=toggle,
    CacheResultsInMemory=True,
    CacheSolveResults=True,
    RemoteDefinitionLocation="C:\git\semio\examples\metabolism\types\blob-base.gh",
    RemoteSolveVersion=(0, 1, 0),
    ShowInput_Enabled=True,
    ShowInput_Path=True,
    SynchronousSolve=False)
hops_3 = Hops(
    _Path=item_4.Item3,
    _Enabled=toggle,
    CacheResultsInMemory=True,
    CacheSolveResults=True,
    RemoteDefinitionLocation="C:\git\semio\examples\metabolism\types\capital.gh",
    RemoteSolveVersion=(0, 1, 0),
    ShowInput_Enabled=True,
    ShowInput_Path=True,
    SynchronousSolve=False)
hops_4 = Hops(
    _Path=item_4.Item2,
    _Enabled=toggle,
    CacheResultsInMemory=True,
    CacheSolveResults=True,
    RemoteDefinitionLocation="C:\git\semio\examples\metabolism\types\bridge.gh",
    RemoteSolveVersion=(0, 1, 0),
    ShowInput_Enabled=True,
    ShowInput_Path=True,
    SynchronousSolve=False)
hops_5 = Hops(
    _Path=item_4.Item4,
    _Enabled=toggle,
    Variant=graft,
    CacheResultsInMemory=True,
    CacheSolveResults=True,
    RemoteDefinitionLocation="C:\git\semio\examples\metabolism\types\capsule-with-balcony.gh",
    RemoteSolveVersion=(0, 1, 0),
    ShowInput_Enabled=True,
    ShowInput_Path=True,
    SynchronousSolve=False)
hops_6 = Hops(
    _Path=item_4.Item6,
    _Enabled=toggle,
    CacheResultsInMemory=True,
    CacheSolveResults=True,
    RemoteDefinitionLocation="C:\git\semio\examples\metabolism\types\cylindric-capital.gh",
    RemoteSolveVersion=(0, 1, 0),
    ShowInput_Enabled=True,
    ShowInput_Path=True,
    SynchronousSolve=False)
hops_7 = Hops(
    _Path=item_4.Item5,
    _Enabled=toggle,
    Variant=graft,
    CacheResultsInMemory=True,
    CacheSolveResults=True,
    RemoteDefinitionLocation="C:\git\semio\examples\metabolism\types\capsule.gh",
    RemoteSolveVersion=(0, 1, 0),
    ShowInput_Enabled=True,
    ShowInput_Path=True,
    SynchronousSolve=False)
hops_8 = Hops(
    _Path=item_4.Item7,
    _Enabled=toggle,
    Variant=graft_2,
    CacheResultsInMemory=True,
    CacheSolveResults=True,
    RemoteDefinitionLocation="C:\git\semio\examples\metabolism\types\cylindric-tambour.gh",
    RemoteSolveVersion=(0, 1, 0),
    ShowInput_Enabled=True,
    ShowInput_Path=True,
    SynchronousSolve=False)
hops_9 = Hops(
    _Path=item_4.Item8,
    _Enabled=toggle,
    Variant=graft,
    CacheResultsInMemory=True,
    CacheSolveResults=True,
    RemoteDefinitionLocation="C:\git\semio\examples\metabolism\types\ellipsoid-capsule.gh",
    RemoteSolveVersion=(0, 1, 0),
    ShowInput_Enabled=True,
    ShowInput_Path=True,
    SynchronousSolve=False)
hops_10 = Hops(
    _Path=item_4.Item10,
    _Enabled=toggle,
    Variant=graft,
    CacheResultsInMemory=True,
    CacheSolveResults=True,
    RemoteDefinitionLocation="C:\git\semio\examples\metabolism\types\trapezoid-capsule.gh",
    RemoteSolveVersion=(0, 1, 0),
    ShowInput_Enabled=True,
    ShowInput_Path=True,
    SynchronousSolve=False)
hops_11 = Hops(
    _Path=item_4.Item9,
    _Enabled=toggle,
    Variant=graft_2,
    CacheResultsInMemory=True,
    CacheSolveResults=True,
    RemoteDefinitionLocation="C:\git\semio\examples\metabolism\types\tambour.gh",
    RemoteSolveVersion=(0, 1, 0),
    ShowInput_Enabled=True,
    ShowInput_Path=True,
    SynchronousSolve=False)
hops_12 = Hops(
    _Enabled=toggle,
    CacheResultsInMemory=True,
    CacheSolveResults=True,
    RemoteSolveVersion=(0, 1, 0),
    ShowInput_Enabled=True,
    ShowInput_Path=True,
    SynchronousSolve=False)
item_5 = ListItem(List=hops_5, Index=0, Wrap=True)
lng = ListLength(List=typ.Type)
merge_2 = Merge(
    Data1=flatten(hops),
    Data2=flatten(hops_2),
    Data3=flatten(hops_4),
    Data4=flatten(hops_3),
    Data5=flatten(item_5),
    Data6=flatten(hops_7),
    Data7=flatten(hops_6),
    Data8=flatten(hops_8),
    Data9=flatten(hops_9),
    Data10=flatten(hops_11),
    Data11=flatten(hops_10))
typ_6 = ModelType(Type=typ.Type)  # -> Type, Valid, Name, Description, Icon, Image, Variant, Unit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
series = Series(Start=0, Step=1, Count=lng)
txt_2 = DecodeText(EncodedText=merge_2)
concat_7 = Concatenate(FragmentA=typ_6.Type, FragmentC="=", FragmentB=series)
typ_7 = DeserializeType(Text=txt_2)
panel_6 = Panel(typ_7)
typ_8 = PutType(Type=typ_7, Uri=concat_4, Run=Toggle(False))
kit = ModelKit(Types=typ_7)  # -> Kit, Valid, Name, Description, Icon, Image, Preview, Version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
list_3 = ValueList({"Typ(Base)": 0, "Typ(Base,Blob)": 1, "Typ(Bridge)": 2, "Typ(Cylindric Capital)": 3, "Typ(Cylindric Tambour)": 4, "Typ(Cylindric Tambour,First Storey)": 5, "Typ(Cylindric Tambour,Last Storey)": 6, "Typ(Cylindric Tambour,Single Storey)": 7, "Typ(Tambour)": 8, "Typ(Tambour,First Storey)": 9, "Typ(Tambour,Last Storey)": 10, "Typ(Tambour,Single Storey)": 11, "Typ(Capital)": 12, "Typ(Capsule,\)": 13, "Typ(Capsule,/)": 14, "Typ(Capsule,p)": 15, "Typ(Capsule,q)": 16, "Typ(Capsule,L)": 17, "Typ(Capsule,J)": 18, "Typ(Capsule,z)": 19, "Typ(Capsule,s)": 20, "Typ(Ellipsoid Capsule,\)": 21, "Typ(Ellipsoid Capsule,/)": 22, "Typ(Ellipsoid Capsule,p)": 23, "Typ(Ellipsoid Capsule,q)": 24, "Typ(Ellipsoid Capsule,L)": 25, "Typ(Ellipsoid Capsule,J)": 26, "Typ(Ellipsoid Capsule,z)": 27, "Typ(Ellipsoid Capsule,s)": 28}, selected="Typ(Base)")
panel_7 = Panel(concat_7)
kit_2 = SerializeKit(Kit=kit.Kit)
# TODO: Figure out what's wrong
# with this script or Hops.
panel_8 = Panel(kit_2)  # disabled
validate = BooleanToggle(True)

spt = ModelScreenPoint(Validate=validate)  # -> ScreenPoint, Valid, X, Y

# ----
# Point missing
# Direction missing
por_3 = ModelPort(Validate=validate)  # -> Port, Valid, Id, Point, Direction, Locators, Locators_2

number_slider = Slider(5, range=-10..10)  # disabled
number_slider_2 = Slider(-7, range=-10..10)  # disabled
number_slider_3 = Slider(8, range=-10..10)  # disabled
number_slider_4 = Slider(-0.4, range=-10..10)  # disabled
number_slider_5 = Slider(-4.5, range=-10..10)  # disabled
number_slider_6 = Slider(-1.1, range=-10..10)  # disabled
number_slider_7 = Slider(3.2, range=-10..10)  # disabled
number_slider_8 = Slider(-4.1, range=-10..10)  # disabled
number_slider_9 = Slider(-2.2, range=-10..10)  # disabled

toggle_2 = BooleanToggle(True)
curdir = CurrentDirectory()  # -> D, P, PP, S
# ---------- curdir: C# ----------
#region Usings
using System;
using System.Linq;
using System.Collections;
using System.Collections.Generic;
using System.Drawing;
using System.IO;

using Rhino;
using Rhino.Geometry;

using Grasshopper;
using Grasshopper.Kernel;
using Grasshopper.Kernel.Data;
using Grasshopper.Kernel.Types;
#endregion

public class Script_Instance : GH_ScriptInstance
{
    private void RunScript(ref object D, ref object P, ref object PP, ref object S)
    {
        D = Path.GetDirectoryName(this.GrasshopperDocument.FilePath);
        var p = new DirectoryInfo(this.GrasshopperDocument.FilePath).Parent.Parent;
        P = p.ToString();
        PP = p.Parent.ToString();
        S = Path.DirectorySeparatorChar;
    }
}
# ---------- end curdir ----------
concat_8 = Concatenate(FragmentA=curdir.D, FragmentD=curdir.S, FragmentB="local")
concat_9 = Concatenate(FragmentA=concat_8, FragmentC=curdir.S, FragmentE="kit")

# ----
# Url missing
rep_2 = ModelRepresentation(Validate=validate)  # -> Representation, Valid, Url, Mime, Lod, Tags

# ----
# Group missing
loc_3 = ModelLocator(Validate=validate)  # -> Locator, Valid, Group, Subgroup

custom_plane = BooleanToggle(False)  # disabled
ty_3 = Type(null)
ty_4 = Type(null)
ty_5 = Type(null)
ty_6 = Type(null)
merge_3 = Merge(Data1=ty_3, Data2=ty_4)
merge_4 = Merge(Data1=ty_6, Data2=ty_4)

# ----
# Constructors
# Name missing
qal = ModelQuality(Validate=validate)  # -> Quality, Valid, Name, Value, Unit, Definition

pt = ConstructPoint(XCoordinate=number_slider, YCoordinate=number_slider_2, ZCoordinate=number_slider_3)  # disabled
pt_2 = ConstructPoint(XCoordinate=number_slider_4, YCoordinate=number_slider_5, ZCoordinate=number_slider_6)  # disabled

# ----
# Connected equal Connecting
con = ModelConnection(Validate=validate)  # -> Connection, Valid, ConnectedPieceId, ConnectedPieceTypePortId, ConnectingPieceId, ConnectingPieceTypePortId, Rotation, Tilt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

pt_3 = ConstructPoint(XCoordinate=number_slider_7, YCoordinate=number_slider_8, ZCoordinate=number_slider_9)  # disabled
merge_5 = Merge(Data1=merge_3, Data2=ty_5)

# ----
# Type Name missing
pce = ModelPiece(Validate=validate)  # -> Piece, Valid, Id, TypeName, TypeVariant, Plane, DiagramPoint

pl_3pt = Plane3Pt(PointA=pt, PointB=pt_2, PointC=pt_3)  # disabled
xy = XYPlane(Origin=Point(0, 0, 0))  # disabled
filter = StreamFilter(Gate=custom_plane, Stream0=xy, Stream1=pl_3pt)  # disabled

# ----
# Creating Kit without losing information
kit_3 = DeleteKit(Url=concat_9, Run=toggle_2)  # disabled
kt = Kit("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")  # disabled
expression = Expression(x=toggle_2, y=kit_3, Expression="x")  # disabled
kit_4 = SerializeKit(Kit=kt)  # disabled
kit_5 = CreateKit(Kit=kt, Uri=concat_9, Run=False)  # disabled
expression_2 = Expression(x=toggle_2, y=kit_5, Expression="x")  # disabled
kit_6 = LoadKit(Uri=concat_9, Run=expression_2)  # -> Success, Kit, LocalDirectory; disabled
kit_7 = SerializeKit(Kit=kit_6.Kit)  # disabled
expression_3 = Expression(x=kit_4, y=kit_7, Expression="x=y")  # disabled
must_be_true = Panel(expression_3)  # disabled

# ----
# Overwrite types and designs
expression_4 = Expression(x=toggle_2, y=must_be_true, Expression="x")  # disabled
kt_2 = Kit("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")  # disabled
kit_8 = ModelKit(Kit=kt_2)  # -> Kit, Valid, Name, Description, Icon, Version, Remote, Homepage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; disabled
kit_9 = DeleteKit(Url=concat_9, Run=expression_4)  # disabled
expression_5 = Expression(x=expression_4, y=kit_9, Expression="x")  # disabled
trim = TrimTree(Tree=kit_8.Types, Depth=1)  # disabled
trim_2 = TrimTree(Tree=kit_8.Designs, Depth=1)  # disabled
kit_10 = NormalizeKit(kt=kt_2)  # disabled
kit_11 = CreateKit(Kit=kt_2, Uri=concat_9, Run=False)  # disabled
typ_9 = PutType(Type=trim, Uri=concat_9, Run=False)  # disabled
dsn = PutDesign(Design=trim_2, Uri=concat_9, Run=False)  # disabled
kit_12 = SerializeKit(Kit=kit_10)  # disabled
expression_6 = Expression(x=expression_4, y=kit_11, Expression="x")  # disabled
item_6 = ListItem(List=typ_9, Index=0, Wrap=True)  # disabled
expression_7 = Expression(x=expression_4, y=item_6, Expression="x")  # disabled
item_7 = ListItem(List=dsn, Index=0, Wrap=True)  # disabled
kit_13 = LoadKit(Uri=concat_9, Run=expression_6)  # -> Success, Kit, LocalDirectory; disabled
expression_8 = Expression(x=expression_4, y=kit_13.Success, Expression="x")  # disabled
expression_9 = Expression(x=expression_4, y=item_7, Expression="x")  # disabled
kit_14 = LoadKit(Uri=concat_9, Run=expression_9)  # -> Success, Kit, LocalDirectory; disabled
kit_15 = NormalizeKit(kt=kit_14.Kit)  # disabled
kit_16 = SerializeKit(Kit=kit_15)  # disabled
expression_10 = Expression(x=kit_12, y=kit_16, Expression="x=y")  # disabled
must_be_true_2 = Panel(expression_10)  # disabled

list_4 = ValueList({"Typ(Base)": 0, "Typ(Base,Blob)": 1, "Typ(Bridge)": 2, "Typ(Cylindric Capital)": 3, "Typ(Cylindric Tambour)": 4, "Typ(Cylindric Tambour,First Storey)": 5, "Typ(Cylindric Tambour,Last Storey)": 6, "Typ(Cylindric Tambour,Single Storey)": 7, "Typ(Tambour)": 8, "Typ(Tambour,First Storey)": 9, "Typ(Tambour,Last Storey)": 10, "Typ(Tambour,Single Storey)": 11, "Typ(Capital)": 12, "Typ(Capsule,\)": 13, "Typ(Capsule,/)": 14, "Typ(Capsule,p)": 15, "Typ(Capsule,q)": 16, "Typ(Capsule,L)": 17, "Typ(Capsule,J)": 18, "Typ(Capsule,z)": 19, "Typ(Capsule,s)": 20, "Typ(Ellipsoid Capsule,\)": 21, "Typ(Ellipsoid Capsule,/)": 22, "Typ(Ellipsoid Capsule,p)": 23, "Typ(Ellipsoid Capsule,q)": 24, "Typ(Ellipsoid Capsule,L)": 25, "Typ(Ellipsoid Capsule,J)": 26, "Typ(Ellipsoid Capsule,z)": 27, "Typ(Ellipsoid Capsule,s)": 28}, selected=["Typ(Tambour)", "Typ(Capsule,\)", "Typ(Capsule,/)", "Typ(Capsule,p)", "Typ(Capsule,q)", "Typ(Capsule,L)", "Typ(Capsule,J)", "Typ(Capsule,z)", "Typ(Capsule,s)"])
list_5 = ValueList({"Typ(Base)": 0, "Typ(Base,Blob)": 1, "Typ(Bridge)": 2, "Typ(Cylindric Capital)": 3, "Typ(Cylindric Tambour)": 4, "Typ(Cylindric Tambour,First Storey)": 5, "Typ(Cylindric Tambour,Last Storey)": 6, "Typ(Cylindric Tambour,Single Storey)": 7, "Typ(Tambour)": 8, "Typ(Tambour,First Storey)": 9, "Typ(Tambour,Last Storey)": 10, "Typ(Tambour,Single Storey)": 11, "Typ(Capital)": 12, "Typ(Capsule,\)": 13, "Typ(Capsule,/)": 14, "Typ(Capsule,p)": 15, "Typ(Capsule,q)": 16, "Typ(Capsule,L)": 17, "Typ(Capsule,J)": 18, "Typ(Capsule,z)": 19, "Typ(Capsule,s)": 20, "Typ(Ellipsoid Capsule,\)": 21, "Typ(Ellipsoid Capsule,/)": 22, "Typ(Ellipsoid Capsule,p)": 23, "Typ(Ellipsoid Capsule,q)": 24, "Typ(Ellipsoid Capsule,L)": 25, "Typ(Ellipsoid Capsule,J)": 26, "Typ(Ellipsoid Capsule,z)": 27, "Typ(Ellipsoid Capsule,s)": 28}, selected=["Typ(Tambour)", "Typ(Capsule,\)", "Typ(Capsule,/)", "Typ(Capsule,p)", "Typ(Capsule,q)", "Typ(Capsule,L)", "Typ(Capsule,J)", "Typ(Capsule,z)", "Typ(Capsule,s)"])
txt_3 = EncodeText(Text=concat_9)  # disabled

# ----
# Name missing
typ_10 = ModelType(Validate=validate)  # -> Type, Valid, Name, Description, Icon, Variant, Unit, Representations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

# ----
# Name missing
dsn_2 = ModelDesign(Validate=validate)  # -> Design, Valid, Name, Description, Icon, Variant, Unit, Pieces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

panel_9 = Panel("icons/metabolism.svg")
panel_10 = Panel(txt_3)  # disabled

# ----
# Name missing
kit_17 = ModelKit(Validate=validate)  # -> Kit, Valid, Name, Description, Icon, Version, Remote, Homepage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

panel_11 = Panel("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")
panel_12 = Panel("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")
ty_7 = Type([null x29])
panel_13 = Panel("IdToooooooooooooooooooooooooooooooooooooooLooooooooooooooooooooooooooooooooooooooooooooooooooongggggggggggggggggggggggggggggggggg")
panel_14 = Panel("NameToooooooooooooooooLoooooooooooooooooooooonggggggggggggggggggg")
panel_15 = Panel("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")
item_8 = ListItem(List=ty_7, Index=list_4, Wrap=True)

and = GateAnd(A=must_be_true, B=must_be_true_2, C=must_be_true)  # disabled
must_be_true_3 = Panel(and)  # disabled

item_9 = ListItem(List=ty_7, Index=list_5, Wrap=True)
panel_16 = Panel("SecondName")
panel_17 = Panel("""{
    "pieces": [
        {
            "id_": "T0",
            "type": {
                "name": "Tambour",
                "variant": ""
            }
        },
        {
            "id_": "T1",
            "type": {
                "name": "Tambour",
                "variant": ""
            }
        },
        {
            "id_": "T2",
            "type": {
                "name": "Tambour",
                "variant": ""
            }
        },
        {
            "id_": "T3",
            "type": {
                "name": "Tambour",
                "variant": ""
            }
        },
        {
            "id_": "T4",
            "type": {
                "name": "Tambour",
                "variant": ""
            }
        },
        {
            "id_": "T5",
            "type": {
                "name": "Tambour",
                "variant": ""
            }
        },
        {
            "id_": "T6",
            "type": {
                "name": "Tambour",
                "variant": ""
            }
        },
        {
            "id_": "T7",
            "type": {
                "name": "Tambour",
                "variant": ""
            }
        },
        {
            "id_": "T8",
            "type": {
                "name": "Tambour",
                "variant": ""
            }
        },
        {
            "id_": "T9",
            "type": {
                "name": "Tambour",
                "variant": ""
            }
        },
        {
            "id_": "C0",
            "type": {
                "name": "Capsule",
                "variant": "\\"
            }
        },
        {
            "id_": "C1",
            "type": {
                "name": "Capsule",
                "variant": "/"
            }
        },
        {
            "id_": "C2",
            "type": {
                "name": "Capsule",
                "variant": "p"
            }
        },
        {
            "id_": "C3",
            "type": {
                "name": "Capsule",
                "variant": "q"
            }
        },
        {
            "id_": "C4",
            "type": {
                "name": "Capsule",
                "variant": "L"
            }
        },
        {
            "id_": "C5",
            "type": {
                "name": "Capsule",
                "variant": "J"
            }
        },
        {
            "id_": "C6",
            "type": {
                "name": "Capsule",
                "variant": "z"
            }
        },
        {
            "id_": "C7",
            "type": {
                "name": "Capsule",
                "variant": "s"
            }
        },
        {
            "id_": "C8",
            "type": {
                "name": "Capsule",
                "variant": "\\"
            }
        },
        {
            "id_": "C9",
            "type": {
                "name": "Capsule",
                "variant": "/"
            }
        },
        {
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""")
dsn_3 = PredictDesign(Description="Tambour with a capsule on every door.", Types=item_8, Run=Toggle(False))  # -> Success, Design
dsn_4 = PredictDesign(Description="A stack of ten tambours with a capsule on every door.", Types=item_9, Run=Toggle(False))  # -> Success, Design

# ----
# Id too long
pt_4 = ConstructPoint(XCoordinate=0, YCoordinate=0, ZCoordinate=0)
X = UnitX(Factor=1)
por_4 = ModelPort(Validate=validate, Id=panel_13, Point=pt_4, Direction=X)  # -> Port, Valid, Id, Point, Direction, Locators, Locators_2

# ----
# Url too long
rep_3 = ModelRepresentation(Validate=validate, Url="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")  # -> Representation, Valid, Url, Mime, Lod, Tags

# ----
# Lod too long
rep_4 = ModelRepresentation(Validate=validate, Url="https://url", Mime="https://url", Lod=panel_14)  # -> Representation, Valid, Url, Mime, Lod, Tags

# ----
# Description too long
typ_11 = ModelType(Validate=validate, Name="Name", Description=panel_15)  # -> Type, Valid, Name, Description, Icon, Variant, Unit, Representations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

dam = DataDam(DataA=dsn_4.Design, BufferDelay=10000000, BufferMode=0)

# ----
# Props
# Tag too long
rep_5 = ModelRepresentation(Validate=validate, Url="https://url", Mime="https://url", Tags=panel_14)  # -> Representation, Valid, Url, Mime, Lod, Tags

# ----
# Id too long
pce_2 = ModelPiece(Validate=validate, Id=panel_13, TypeName="Name")  # -> Piece, Valid, Id, TypeName, TypeVariant, Plane, ScreenPoint

curdir_2 = CurrentDirectory()  # -> D, P, PP, S; same code as curdir

# ----
# Save the designs
merge_6 = Merge()  # disabled
save = BooleanToggle(False)  # disabled
dsn_5 = PutDesign(Design=merge_6, Run=False)  # disabled

dir_4 = Directory(D=curdir_2.D)  # -> AP, Pa; same code as dir_2

# ----
# Description too long
dsn_6 = ModelDesign(Validate=validate, Name="Name", Description=panel_15)  # -> Design, Valid, Name, Description, Icon, Variant, Unit, Pieces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

dir_5 = Directory(D=dir_4.Pa)  # -> AP, Pa; same code as dir_2

# ----
# Mime too long
rep_6 = ModelRepresentation(Validate=validate, Url="https://url", Mime=panel_13)  # -> Representation, Valid, Url, Mime, Lod, Tags

txt_4 = Text(null)
concat_10 = Concatenate(FragmentA=dir_5.Pa, FragmentB="\python\engine\temp\011\predicted-design-healed.json")
file = ReadFile(File=concat_10, PerLineParse=False)
dsn_7 = DeserializeDesign(Text=file)
dam_2 = DataDam(DataA=dsn_7, BufferDelay=10000000, BufferMode=0)
shwdsn = ShowDesign_2(dn=dam_2, ty=ty_7, mm="model/vnd.3dm", lod="1to200", tags="volume")  # -> id_2, ur_2, pa_ur_2, pln_2

# ----
# Description too long
kit_18 = ModelKit(Validate=validate, Name="Name", Description=panel_15)  # -> Kit, Valid, Name, Description, Icon, Version, Remote, Homepage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

typ_12 = ModelType()  # -> Type, Valid, Name, Description, Icon, Variant, Unit, Representations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; disabled
por_5 = ModelPort(Port=typ_12.Ports)  # -> Port, Valid, Id, Point, Direction, Locators, Locators_2; disabled
curdir_3 = CurrentDirectory()  # -> D, P, PP, S; same code as curdir
loc_4 = ModelLocator(Locator=por_5.Locators)  # -> Locator, Valid, Group, Subgroup; disabled

# ----
# Connected equal Connecting
con_2 = ModelConnection(Validate=validate, ConnectedPieceId="0", ConnectingPieceId="0")  # -> Connection, Valid, ConnectedPieceId, ConnectedPieceTypePortId, ConnectingPieceId, ConnectingPieceTypePortId, Rotation, Tilt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

panel_18 = Panel("before.json")  # disabled
panel_19 = Panel("after.json")  # disabled
relay = Relay()  # disabled
concat_11 = Concatenate(FragmentA=curdir_3.PP, FragmentD=curdir_3.S, FragmentB="examples", FragmentC=curdir_3.S, FragmentE="metabolism")
item_10 = ListItem(Index=0, Wrap=True)  # -> Item1, Item; disabled
rep_7 = ReplaceText(Text=shwdsn.ur_2, Find="/", Replace=curdir_3.S, RecursiveReplace=False)
concat_12 = Concatenate(FragmentA=concat_11, FragmentB=curdir_3.S, FragmentC=rep_7)
geo = LoadGeometry(path=concat_12, pln=shwdsn.pln_2, run=Toggle(True))  # -> object_4, col_2, shader_2
geo_2 = Geometry(geo.object_4)
fltdsn = FlattenDesign(Design=relay)  # disabled
relay_2 = Relay()  # disabled
relay_3 = Relay()  # disabled
concat_13 = Concatenate(FragmentA=concat_8, FragmentC=curdir.S, FragmentE=panel_19)  # disabled
toggle_3 = BooleanToggle(False)  # disabled
toggle_4 = BooleanToggle(False)  # disabled

# ----
# Piece not part
con_3 = ModelConnection(ConnectedPieceId="0", ConnectingPieceId="1")  # -> Connection, Valid, ConnectedPieceId, ConnectedPieceTypePortId, ConnectingPieceId, ConnectingPieceTypePortId, Rotation, Tilt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
dsn_8 = ModelDesign(Validate=validate, Name="Name", Connections=con_3.Connection)  # -> Design, Valid, Name, Description, Icon, Image, Variant, View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

toggle_5 = BooleanToggle(False)  # disabled
toggle_6 = BooleanToggle(False)  # disabled
toggle_7 = BooleanToggle(False)  # disabled
toggle_8 = BooleanToggle(False)  # disabled
toggle_9 = BooleanToggle(False)  # disabled
kit_19 = SerializeKit()  # disabled
dsn_9 = SerializeDesign(Design=fltdsn)  # disabled
typ_13 = SerializeType()  # disabled
concat_14 = Concatenate(FragmentA=concat_8, FragmentC=curdir.S, FragmentE=panel_18)  # disabled
relay_4 = Relay()  # disabled
kit_20 = CreateKit(Kit=relay_4, Uri=concat_9, Run=False)  # disabled
kit_21 = DeleteKit(Url=concat_9, Run=toggle_5)  # disabled
kit_22 = LoadKit(Url=concat_9, Run=toggle_7)  # -> Kit, Success, LocalDirectory; disabled
py3 = Python3Script(path=concat_14)  # -> out; inputs path: String, content: String; disabled
# ---------- py3: Python ----------
if run:
    with open(path, 'w', encoding='utf-8') as f:
        f.write(content)
# ---------- end py3 ----------
py3_2 = Python3Script(path=concat_13)  # -> out; inputs path: String, content: String; disabled; same code as py3
typ_14 = PutType(Uri=concat_9, Run=False)  # disabled
typ_15 = RemoveType(Uri=concat_9, Run=False)  # disabled
dsn_10 = PutDesign(Uri=concat_9, Run=False)  # disabled
file_2 = ReadFile(File=concat_14, PerLineParse=False)  # disabled
dsn_11 = RemoveDesign(Uri=concat_9, Run=False)  # disabled

panel_20 = Panel("1ef59aec9f6d93a2878d3771c6401209c9ba597c")
panel_21 = Panel("main-tag")
# UserObjects
panel_22 = Panel("usalu")
ghbkit = GitHubKit(domain="github.com", account="metabolism", repo="main", branch="main")  # -> remote_2, homepage_2
panel_23 = Panel(ghbkit.remote_2)
panel_24 = Panel(ghbkit.homepage_2)
panel_25 = Panel("https://github.com/usalu/metabolism/archive/1ef59aec9f6d93a2878d3771c6401209c9ba597c.zip")
panel_26 = Panel("https://github.com/usalu/metabolism/tree/1ef59aec9f6d93a2878d3771c6401209c9ba597c")

# ----
# Create, delete or load the kit
panel_27 = Panel("Everything for metabolistic architecture.")
dn = Design([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])
create_kit = BooleanToggle(False)
delete_kit = BooleanToggle(False)
load_kit = BooleanToggle(True)
validate_2 = BooleanToggle(False)
kit_23 = DeleteKit(Uri=concat_9, Run=delete_kit)

ghbkit_2 = GitHubKit(domain="github.com", account="usalu", repo="metabolism", tag="r24.12-2")  # -> remote_2, homepage_2
kit_24 = LoadKit(Uri=concat_9, Run=load_kit)  # -> Success, Kit, LocalDirectory
kit_25 = ModelKit(Kit=kit_24.Kit)  # -> Kit, Valid, Name, Description, Icon, Image, Preview, Version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

kit_26 = ModelKit(
    Name="Metabolism",
    Description=panel_27,
    Icon="🫀",
    Image="images/metabolism.png",
    Preview="docs/preview.png",
    Version="r24.12-2",
    Remote=ghbkit_2.remote_2,
    Homepage=ghbkit_2.homepage_2,
    Types=merge_3)  # -> Kit, Valid, Name, Description, Icon, Image, Preview, Version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
kit_27 = CreateKit(Kit=kit_26.Kit, Uri=concat_9, Run=create_kit)
trim_3 = TrimTree(Tree=kit_25.Types, Depth=1)

# ----
# Normalization not affecting semantics
item_11 = ListItem(List=dn, Index=0, Wrap=True)  # disabled
dsn_12 = NormalizeDesign(dn=item_11)  # disabled
shwdsn_2 = ShowDesign(dn=item_11, ty=trim_3, mm="model/vnd.3dm")  # -> id_2, ur_2, pln_2; disabled
shwdsn_3 = ShowDesign(dn=dsn_12, ty=trim_3, mm="model/vnd.3dm")  # -> id_2, ur_2, pln_2; disabled
tsort = SortText(Keys=shwdsn_3.id_2, Values=shwdsn_3.pln_2, Culture=127)  # -> Keys, Values; disabled
tsort_2 = SortText(Keys=shwdsn_2.id_2, Values=shwdsn_2.pln_2, Culture=127)  # -> Keys, Values; disabled
expression_11 = Expression(x=tsort_2.Values, y=tsort.Values, Expression="x=y")  # disabled
mm = MassMultiplication(Input=expression_11)  # -> Result, PartialResults; disabled
bool = Boolean(mm.Result)  # disabled
must_be_true_4 = Panel(bool)  # disabled

typ_16 = ModelType(Type=trim_3)  # -> Type, Valid, Name, Description, Icon, Image, Variant, Unit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
typ_17 = SerializeType(Type=trim_3)
item_12 = ListItem(List=dn, Index=0, Wrap=True)  # -> Item1, Item; disabled
kt_3 = Kit(kit_24.Kit)  # disabled
shwdsn_4 = ShowDesign(dn=item_12.Item1, ty=trim_3, mm="model/vnd.3dm")  # -> id_2, ur_2, pln_2; disabled
shwdsn_5 = ShowDesign(dn=item_10.Item1, ty=trim_3, mm="model/vnd.3dm")  # -> id_2, ur_2, pln_2; disabled
rep_8 = ReplaceText(Text=shwdsn_4.ur_2, Find="/", Replace=curdir_3.S, RecursiveReplace=False)  # disabled
rep_9 = ReplaceText(Text=shwdsn_5.ur_2, Find="/", Replace=curdir_3.S, RecursiveReplace=False)  # disabled
concat_15 = Concatenate(FragmentA=concat_11, FragmentB=curdir_3.S, FragmentC=rep_8)  # disabled
concat_16 = Concatenate(FragmentA=concat_11, FragmentB=curdir_3.S, FragmentC=rep_9)  # disabled
load_geometry = Geo(path=concat_15, pln=shwdsn_4.pln_2)  # disabled
load_geometry_2 = Geo(path=concat_16, pln=shwdsn_5.pln_2)  # disabled
expression_12 = Expression(x=shwdsn_4.pln_2, y=shwdsn_5.pln_2, Expression="x=y")  # disabled
ma = MassAddition(Input=expression_12)  # -> Result, PartialResults; disabled
semio_preview = SemioPrv(geo=flatten(load_geometry))  # disabled
semio_preview_2 = SemioPrv(geo=flatten(load_geometry_2))  # disabled

# ==== cluster ShowDesign: Show a design by flattening it and selecting only representations with the same mime, lod and tags.
ty = ClusterInput()
dn = ClusterInput()
mm = ClusterInput()
lod = ClusterInput()
tags = ClusterInput()
ty_2 = Type(ty)
mm_2 = Mime(mm)
tags_2 = Tags(tags)
dn_2 = Design(dn)
lod_2 = Lod(lod)
fltdsn = FlattenDesign(Design=dn_2, Type=ty_2)
typ = ModelType(Type=ty_2)  # -> Type, Valid, Name, Description, Icon, Variant, Unit, Representations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
dsn = ModelDesign(Design=fltdsn)  # -> Design, Valid, Name, Description, Icon, Variant, Unit, Pieces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
tstat = TreeStatistics(Tree=typ.Representations)  # -> Paths, Length, Count
trim = TrimTree(Tree=dsn.Pieces, Depth=1)
pce = ModelPiece(Piece=trim)  # -> Piece, Valid, Id, TypeName, TypeVariant, Plane, ScreenPoint
lng = ListLength(List=ty_2)
expression = Expression(x=graft(pce.TypeName), y=typ.Name, Expression="x=y")
expression_2 = Expression(x=graft(pce.TypeVariant), y=typ.Variant, Expression="x=y")
series = Series(Start=0, Step=1, Count=lng)
and = GateAnd(A=expression, B=expression_2)
trim_2 = TrimTree(Tree=series, Depth=1)
cull = CullPattern(List=ty_2, CullPattern=and)
txt = Text(cull)
txt_2 = Text(ty_2)
expression_3 = Expression(x=txt, y=txt_2, Expression="x=y")
cull_2 = CullPattern(List=trim_2, CullPattern=expression_3)
trim_3 = TrimTree(Tree=cull_2, Depth=1)
item = ListItem(List=tstat.Paths, Index=trim_3, Wrap=True)
branch = TreeBranch(Tree=typ.Representations, Path=item, MaintainPaths=False)
mrg_p = MergeSeperatlyPrepend(x=branch)  # -> Mrgd; inputs x: tree
# ---------- mrg_p: Python ----------
if ghenv.Component.RunCount<2:
    __author__ = "Ueli Saluz"
    __version__ = "2020.05.28"
    
    ghenv.Component.Name = "MergeSeperatly(Prepend)"
    ghenv.Component.NickName = "Mrg(P)"
    ghenv.Component.Description = "Merge inputs seperatly on a new path. Prepend index of input parameter for distincting."
    ghenv.Component.Message = "VER 1.0"

from System import Object
from Grasshopper import DataTree
from Grasshopper.Kernel import GH_ParamAccess as Access

if __name__ == "__main__":
    Mrgd = DataTree[Object]()
    access = Access()
    
    for input in ghenv.Component.Params.Input:  #set all Inputaccess to Tree Access
        input.Access = access.tree
    
    for i,input in enumerate(ghenv.Component.Params.Input):
        for j,source in enumerate(input.Sources):
            for path in source.VolatileData.Paths:
                Mrgd.AddRange(source.VolatileData[path],path.PrependElement(i))
# ---------- end mrg_p ----------
rep = ModelRepresentation(Representation=mrg_p)  # -> Representation, Valid, Url, Mime, Lod, Tags
expression_4 = Expression(x=rep.Mime, y=mm_2, Expression="x=y")
cull_3 = CullPattern(List=rep.Representation, CullPattern=expression_4)
rep_2 = ModelRepresentation(Representation=cull_3)  # -> Representation, Valid, Url, Mime, Lod, Tags
expression_5 = Expression(x=rep_2.Lod, y=lod_2, Expression="x=y")
cull_4 = CullPattern(List=rep_2.Representation, CullPattern=expression_5)
trim_4 = TrimTree(Tree=cull_4, Depth=1)
rep_3 = ModelRepresentation(Representation=trim_4)  # -> Representation, Valid, Url, Mime, Lod, Tags
ur = Url(rep_3.Url)
id = Id(pce.Id)
pln = Plane(pce.Plane)
ur_2 = ClusterOutput(ur)
pln_2 = ClusterOutput(pln)
id_2 = ClusterOutput(id)

# ==== cluster NormalizeDesign: Normalize a design for this document. This includes changing the unit to the document unit and rescaling the affected values. Further it reoders pieces, connections and qualities. Connections might be swapped, so that the connected piece id is lexically first.
dn = ClusterInput()
dn_2 = Design(graft(dn))
dsn = ModelDesign()  # -> Design, Valid, Name, Description, Icon, Variant, Unit, Pieces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
dsn_2 = ModelDesign(Design=dn_2)  # -> Design, Valid, Name, Description, Icon, Variant, Unit, Pieces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
trim = TrimTree(Tree=dsn_2.Pieces, Depth=1)
trim_2 = TrimTree(Tree=dsn_2.Qualities, Depth=1)
trim_3 = TrimTree(Tree=dsn_2.Connections, Depth=1)
cnvunt = ConvertUnit(Value=1, FromUnit=dsn_2.Unit, ToUnit=dsn.Unit)
con = ModelConnection(Connection=trim_3)  # -> Connection, Valid, ConnectedPieceId, ConnectedPieceTypePortId, ConnectingPieceId, ConnectingPieceTypePortId, Rotation, Tilt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
multiplication = Multiplication(A=con.Gap, B=cnvunt)
multiplication_2 = Multiplication(A=con.Shift, B=cnvunt)
con_2 = ModelConnection(Connection=con.Connection, Gap=multiplication, Shift=multiplication_2)  # -> Connection, Valid, ConnectedPieceId, ConnectedPieceTypePortId, ConnectingPieceId, ConnectingPieceTypePortId, Rotation, Tilt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
merge = Merge(Data1=graft(con_2.ConnectedPieceId), Data2=graft(con_2.ConnectingPieceId))
tsort = SortText(Keys=merge, Culture=127)  # -> Keys, Values
trim_4 = TrimTree(Tree=tsort.Keys, Depth=1)
expression = Expression(x=merge, y=trim_4, Expression="x=y")
item = ListItem(List=expression, Index=0, Wrap=True)
trim_5 = TrimTree(Tree=item, Depth=1)
dispatch = Dispatch(List=con_2.Connection, DispatchPattern=trim_5)  # -> ListA, ListB
con_3 = ModelConnection(Connection=dispatch.ListB)  # -> Connection, Valid, ConnectedPieceId, ConnectedPieceTypePortId, ConnectingPieceId, ConnectingPieceTypePortId, Rotation, Tilt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
con_4 = ModelConnection(
    Connection=dispatch.ListB,
    ConnectedPieceId=con_3.ConnectingPieceId,
    ConnectedPieceTypePortId=con_3.ConnectingPieceTypePortId,
    ConnectingPieceId=con_3.ConnectedPieceId,
    ConnectingPieceTypePortId=con_3.ConnectedPieceTypePortId)  # -> Connection, Valid, ConnectedPieceId, ConnectedPieceTypePortId, ConnectingPieceId, ConnectingPieceTypePortId, Rotation, Tilt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
merge_2 = Merge(Data1=dispatch.ListA, Data2=con_4.Connection)
con_5 = ModelConnection(Connection=merge_2)  # -> Connection, Valid, ConnectedPieceId, ConnectedPieceTypePortId, ConnectingPieceId, ConnectingPieceTypePortId, Rotation, Tilt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
concat = Concatenate(FragmentA=con_5.ConnectedPieceId, FragmentC="##", FragmentB=con_5.ConnectingPieceId)
qal = ModelQuality(Quality=trim_2)  # -> Quality, Valid, Name, Value, Unit, Definition
pce = ModelPiece(Piece=trim)  # -> Piece, Valid, Id, TypeName, TypeVariant, Plane, ScreenPoint
tsort_2 = SortText(Keys=concat, Values=con_5.Connection, Culture=127)  # -> Keys, Values
tsort_3 = SortText(Keys=qal.Name, Values=qal.Quality, Culture=127)  # -> Keys, Values
tsort_4 = SortText(Keys=pce.Id, Values=pce.Piece, Culture=127)  # -> Keys, Values
trim_6 = TrimTree(Tree=tsort_2.Values, Depth=1)
trim_7 = TrimTree(Tree=tsort_3.Values, Depth=1)
trim_8 = TrimTree(Tree=tsort_4.Values, Depth=1)
dsn_3 = ModelDesign(Design=dsn_2.Design, Unit=dsn.Unit, Pieces=trim_8, Connections=trim_6, Qualities=trim_7)  # -> Design, Valid, Name, Description, Icon, Variant, Unit, Pieces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
trim_9 = TrimTree(Tree=dsn_3.Design, Depth=1)
dn_3 = Design(trim_9)
dn_4 = ClusterOutput(dn_3)

# ==== cluster NormalizeKit: Normalize a kit to this document. This normalizes all types and designs and reorders them according their name and variant
kt = ClusterInput()
kt_2 = Kit(graft(kt))
kit = ModelKit(Kit=kt_2)  # -> Kit, Valid, Name, Description, Icon, Version, Remote, Homepage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
trim = TrimTree(Tree=kit.Designs, Depth=1)
trim_2 = TrimTree(Tree=kit.Types, Depth=1)
dsn = NormalizeDesign(dn=trim)
typ = NormalizeType(ty=trim_2)
typ_2 = ModelType(Type=typ)  # -> Type, Valid, Name, Description, Icon, Variant, Unit, Representations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
dsn_2 = ModelDesign(Design=dsn)  # -> Design, Valid, Name, Description, Icon, Variant, Unit, Pieces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
concat = Concatenate(FragmentA=typ_2.Name, FragmentB="##", FragmentC=typ_2.Variant)
concat_2 = Concatenate(FragmentA=dsn_2.Name, FragmentB="##", FragmentC=dsn_2.Variant)
tsort = SortText(Keys=concat, Values=typ_2.Type, Culture=127)  # -> Keys, Values
tsort_2 = SortText(Keys=concat_2, Values=dsn_2.Design, Culture=127)  # -> Keys, Values
trim_3 = TrimTree(Tree=tsort.Values, Depth=1)
trim_4 = TrimTree(Tree=tsort_2.Values, Depth=1)
kit_2 = ModelKit(Kit=kit.Kit, Types=trim_3, Designs=trim_4)  # -> Kit, Valid, Name, Description, Icon, Version, Remote, Homepage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
trim_5 = TrimTree(Tree=kit_2.Kit, Depth=1)
kt_3 = Kit(trim_5)
kt_4 = ClusterOutput(kt_3)

# ==== cluster Geo
path = ClusterInput()
pln = ClusterInput()
path_2 = FilePath(path)

pln_2 = Plane(graft(pln))
cset = CreateSet(List=path_2)  # -> Set, Map
panel = Panel("*")
_3dm = Import3DM(File=graft(cset.Set), Layer="*", Name="*")
lng = ListLength(List=cset.Set)
expression = Expression(x=lng, Expression="x>1")
trim = TrimTree(Tree=_3dm, Depth=1)
filter = StreamFilter(Gate=expression, Stream0=_3dm, Stream1=trim)
tstat = TreeStatistics(Tree=filter)  # -> Paths, Length, Count
item = ListItem(List=tstat.Paths, Index=cset.Map, Wrap=True)
branch = TreeBranch(Tree=filter, Path=item, MaintainPaths=False)
match = MatchTree(Tree=branch, Guide=pln_2)
mtchanc = MatchAncestor(AT=pln_2, CT=graft(match))  # -> MAT; inputs AT: tree, CT: tree
# ---------- mtchanc: Python ----------
if ghenv.Component.RunCount<2:
    __author__ = "Ueli Saluz"
    __version__ = "2022.04.25"
    
    ghenv.Component.Name = "Match Ancestor"
    ghenv.Component.NickName = "MtchAnc"
    ghenv.Component.Description = "Duplicates all elements of an ancestor tree to match the amount of elements in the child tree."
    ghenv.Component.Message = "VER 1.1"
    
    ghenv.Component.Params.Input[0].Name = "AncestorTree"
    ghenv.Component.Params.Input[0].NickName = "AT"
    ghenv.Component.Params.Input[0].Description = "Ancestor tree that data will the duplicated until it matches the child tree"
    ghenv.Component.Params.Input[0].Optional = False
    
    ghenv.Component.Params.Input[1].Name = "ChildTree"
    ghenv.Component.Params.Input[1].NickName = "CT"
    ghenv.Component.Params.Input[1].Description = "Child tree that branches will the guide to duplicat the data of the ancestor tree"
    ghenv.Component.Params.Input[0].Optional = False
    
    ghenv.Component.Params.Output[0].Name = "MatchedAncestorTree"
    ghenv.Component.Params.Output[0].NickName = "MAT"
    ghenv.Component.Params.Output[0].Description = "Matched ancestor tree with the amount of items and the branch paths of the child tree"

from System import Object
from Grasshopper import DataTree

"""Returns a new tree with the ancestor data being duplicated along all child branches which where child paths of that ancestor.
    Inputs:
        ancestorTree: Ancestor tree that data will the duplicated until it matches the child tree
        childTree: Child tree that branches will the guide to duplicat the data of the ancestor tree
    Output:
        matchedAncestorTree: Matched ancestor tree with the amount of items and the branch paths of the child tree"""
def MatchAncestorTreeToChildTree (ancestorTree, childTree):
    
    matchedAncestorTree = DataTree[Object]()
    dummy = 0
    for i,pathAncestor in enumerate(ancestorTree.Paths):
        branch = ancestorTree.Branch(pathAncestor)
        if len(branch)!=1:
            raise Exception("Ancestor must be grafted and containing one item per branch")
        #The item to be duplicated
        item = branch[0]
        for j,pathChild in enumerate(childTree.Paths):
            #Returns a tuple and not like in the documentation described a bool with a pointer to the int to store the generations
            checkAncestor = pathChild.IsAncestor(pathAncestor,dummy)
            if(checkAncestor[0]):
                matchedAncestorTree.AddRange([item]*childTree.Branch(pathChild).Count,pathChild)
    return matchedAncestorTree

if __name__ == "__main__":
    MAT = MatchAncestorTreeToChildTree (AT,CT)
# ---------- end mtchanc ----------
trim_2 = TrimTree(Tree=mtchanc, Depth=1)
pl2pl = MoveObjectPlaneToPlane(G=match, S=PlaneXY(0, 0, 0), T=trim_2)  # -> TG, T; inputs S: Plane, T: Plane
# ---------- pl2pl: Python ----------
#Component Information
#--------------------------------------------------------------------------------------------
if ghenv.Component.RunCount<2:
    #General
    #--------------------------------------------------------------------------------------------
    __author__ = "Ueli Saluz"
    __version__ = "2023.02.12"
    
    ghenv.Component.Name = "MoveObjectPlaneToPlane"
    ghenv.Component.NickName = "Pl2Pl"
    ghenv.Component.Description = "Moves abitrary geometry from a source plane to a target plane."
    ghenv.Component.Message = "VER 1.2"
    ghenv.Component.Category = "Transform"
    ghenv.Component.SubCategory = "Euclidean"
    
     #Inputs
    #--------------------------------------------------------------------------------------------
    inputIndex=0
    
    ghenv.Component.Params.Input[inputIndex].Name = "Geometry"
    ghenv.Component.Params.Input[inputIndex].NickName = "G"
    ghenv.Component.Params.Input[inputIndex].Description = "Geometry to move."
    ghenv.Component.Params.Input[inputIndex].Optional = False
    inputIndex+=1
    
    ghenv.Component.Params.Input[inputIndex].Name = "SourcePlane"
    ghenv.Component.Params.Input[inputIndex].NickName = "S"
    ghenv.Component.Params.Input[inputIndex].Description = "Source plane of object."
    ghenv.Component.Params.Input[inputIndex].Optional = False
    inputIndex+=1
    
    ghenv.Component.Params.Input[inputIndex].Name = "TargetPlane"
    ghenv.Component.Params.Input[inputIndex].NickName = "T"
    ghenv.Component.Params.Input[inputIndex].Description = "Target plane of object."
    ghenv.Component.Params.Input[inputIndex].Optional = False
    inputIndex+=1
    
    #Outputs
    #--------------------------------------------------------------------------------------------
    outputIndex=0
    
    ghenv.Component.Params.Output[outputIndex].Name = "TranslatedGeometry"
    ghenv.Component.Params.Output[outputIndex].NickName = "TG"
    ghenv.Component.Params.Output[outputIndex].Description = "Translated geometry in target plane."
    outputIndex+=1
    
    ghenv.Component.Params.Output[outputIndex].Name = "Trasnform"
    ghenv.Component.Params.Output[outputIndex].NickName = "T"
    ghenv.Component.Params.Output[outputIndex].Description = "Transform describing translation form source to target plane."
    outputIndex+=1


#Imports
#--------------------------------------------------------------------------------------------
import Rhino.Geometry.Transform as trsf

def MvObjPlnToPln (geo,plnObj,plnDest):
    transform = trsf.PlaneToPlane(plnObj,plnDest)
    geo.Transform(transform)
    return (geo,transform)

TG, T = MvObjPlnToPln(G,S,T)
# ---------- end pl2pl ----------
geo = Geometry(pl2pl.TG)

geo_2 = ClusterOutput(geo)

# ==== cluster SemioPrv: semio styled preview of geometry.
geo = ClusterInput()
geo_2 = Geometry(flatten(geo))
debrep = DeconstructBrep(Brep=geo_2)  # -> Faces, Edges, Vertices
curve_preview = CustomCurvePreview(Curve=flatten(debrep.Edges), Colour=ColourSwatch(SwatchColor=RGB(0, 0, 0)))
preview = CustomPreview(Geometry=flatten(geo_2), Material=ColourSwatch(SwatchColor=RGB(255, 255, 255)))

# ==== cluster GitHubKit: Get the uri and the homepage of the remote kit of a specific version (either a branch name, a tag name or a commit sha) for a kit hosted as a repository on GitHub.
domain = ClusterInput()
account = ClusterInput()
repo = ClusterInput()
branch = ClusterInput()
tag = ClusterInput()
commit = ClusterInput()
commit_2 = Text(commit)
domain_2 = Text(domain)
account_2 = Text(account)
repo_2 = Text(repo)
branch_2 = Text(branch)
tag_2 = Text(tag)
null = NullItem(Item=domain_2)  # -> NullFlags, InvalidFlags, Description

null_2 = NullItem(Item=tag_2)  # -> NullFlags, InvalidFlags, Description
null_3 = NullItem(Item=commit_2)  # -> NullFlags, InvalidFlags, Description
null_4 = NullItem(Item=branch_2)  # -> NullFlags, InvalidFlags, Description
not = GateNot(A=null_2.NullFlags)
not_2 = GateNot(A=null_3.NullFlags)
not_3 = GateNot(A=null_4.NullFlags)
merge = Merge(Data1=not_3, Data2=not, Data3=not_2)
int = Integer(merge)
ma = MassAddition(Input=int)  # -> Result, PartialResults
expression = Expression(x=ma.Result, Expression="x≠1")
null_5 = NullItem(Item=account_2)  # -> NullFlags, InvalidFlags, Description
null_6 = NullItem(Item=repo_2)  # -> NullFlags, InvalidFlags, Description
or = GateOr(A=expression, D=null.NullFlags, B=null_5.NullFlags, C=null_6.NullFlags)

filter = StreamFilter(Gate=null_4.NullFlags, Stream0="heads", Stream1="tags")
filter_2 = StreamFilter(Gate=null_4.NullFlags, Stream0=branch_2, Stream1=tag_2)
concat = Concatenate(FragmentA="https://", FragmentE=domain_2, FragmentF="/", FragmentB=account_2, FragmentC="/", FragmentD=repo_2)
concat_2 = Concatenate(FragmentA="refs/", FragmentB=filter, FragmentC="/")
filter_3 = StreamFilter(Gate=null_3.NullFlags, Stream1=concat_2)
filter_4 = StreamFilter(Gate=null_3.NullFlags, Stream0=commit_2, Stream1=filter_2)
concat_3 = Concatenate(FragmentA=concat, FragmentE="/archive/", FragmentC=filter_3, FragmentF=filter_4, FragmentG=".zip")
concat_4 = Concatenate(
    FragmentA=concat,
    FragmentB="/",
    FragmentC="tree",
    FragmentF="/",
    FragmentD=branch_2,
    FragmentE=tag_2,
    FragmentG=commit_2)

filter_5 = StreamFilter(Gate=or, Stream0=concat_3)
filter_6 = StreamFilter(Gate=or, Stream0=concat_4)
remote = Remote(filter_5)
homepage = Homepage(filter_6)
remote_2 = ClusterOutput(remote)
homepage_2 = ClusterOutput(homepage)

# ==== cluster ShowDesign_2: Show a design by flattening it and selecting only representations with the same mime, lod and tags.
ty = ClusterInput()
dn = ClusterInput()
mm = ClusterInput()
lod = ClusterInput()
tags = ClusterInput()
ty_2 = Type(ty)
mm_2 = Mime(mm)
tags_2 = Tags(tags)
dn_2 = Design(dn)
lod_2 = Lod(lod)
fltdsn = FlattenDesign(Design=dn_2, Type=ty_2)
dsn = ModelDesign(Design=fltdsn)  # -> Design, Valid, Name, Description, Icon, Image, Variant, View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
typ = ModelType(Type=ty_2)  # -> Type, Valid, Name, Description, Icon, Image, Variant, Unit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
trim = TrimTree(Tree=dsn.Pieces, Depth=1)
tstat = TreeStatistics(Tree=typ.Representations)  # -> Paths, Length, Count
pce = ModelPiece(Piece=trim)  # -> Piece, Valid, Id, TypeName, TypeVariant, Plane, ScreenPoint
expression = Expression(x=graft(pce.TypeName), y=typ.Name, Expression="x=y")
expression_2 = Expression(x=graft(pce.TypeVariant), y=typ.Variant, Expression="x=y")
and = GateAnd(A=expression, B=expression_2)
cull = CullPattern(List=ty_2, CullPattern=and)
lng = ListLength(List=ty_2)
txt = Text(cull)
series = Series(Start=0, Step=1, Count=lng)
txt_2 = Text(ty_2)
expression_3 = Expression(x=txt, y=txt_2, Expression="x=y")
trim_2 = TrimTree(Tree=series, Depth=1)
cull_2 = CullPattern(List=trim_2, CullPattern=expression_3)
trim_3 = TrimTree(Tree=cull_2, Depth=1)
item = ListItem(List=tstat.Paths, Index=trim_3, Wrap=True)
branch = TreeBranch(Tree=typ.Representations, Path=item, MaintainPaths=False)
mrg_p = MergeSeperatlyPrepend(x=branch)  # -> Mrgd; inputs x: tree; same code as mrg_p
selrep = SelectRepresentation(rp=mrg_p, mm=mm_2, lod=lod_2, tags=tags_2)  # -> rp_4, ur_2, pa_ur_2
trim_4 = TrimTree(Tree=selrep.ur_2, Depth=1)
trim_5 = TrimTree(Tree=selrep.pa_ur_2, Depth=1)
id = Id(pce.Id)
ur = Url(trim_4)
pa_ur = Url(trim_5)
pln = Plane(pce.Plane)
id_2 = ClusterOutput(id)
ur_2 = ClusterOutput(ur)
pa_ur_2 = ClusterOutput(pa_ur)
pln_2 = ClusterOutput(pln)

# ==== cluster LoadGeometry: Load local geometry from absolute file paths to planes.
path = ClusterInput()
pln = ClusterInput()
run = ClusterInput()
pln_2 = Plane(graft(pln))
path_2 = FilePath(path)
run_2 = Boolean(run)
import = ImportContent(
    FilePath=path_2,
    Name="*",
    Layer="*",
    Linetype="*",
    HatchPattern="*",
    AnnotationStyles="*",
    Materials="*",
    BlockDefinitions="*",
    Import=run_2)  # -> ModelTransform, Objects, Layers, Linetypes, HatchPatterns, AnnotationStyles, Materials, BlockDefinitions
object = ModelObject(Object=import.Objects)  # -> Object, Geometry, Name, Layer, Visibility, Display, Drafting, Render
orient = Orient(Geometry=object.Geometry, Source=PlaneXY(0, 0, 0), Target=pln_2)  # -> Geometry, Transform
object_2 = ModelObject(Object=object.Object, Geometry=orient.Geometry)  # -> Object, Geometry, Name, Layer, Visibility, Display, Drafting, Render
layer = ModelLayer(Layer=object_2.Layer)  # -> Layer, Name, Hidden, Locked, DisplayColour, Material, Linetype
display = DisplayAttributes(Display=object_2.Display)  # -> Display, DisplayColour, DisplayMode
display_colour = DisplayColour(DisplayColour=layer.DisplayColour)  # -> DisplayColour, Source, Colour
material = ModelMaterial(Material=layer.Material)  # -> Material, Name, Shader
display_colour_2 = DisplayColour(DisplayColour=display.DisplayColour)  # -> DisplayColour, Source, Colour
object_3 = ModelObject(object_2.Object)
col = Colour(display_colour.DisplayColour)
shader = Shader(material.Shader)
preview = CustomPreview(Geometry=object_3, Material=material.Shader)
object_4 = ClusterOutput(object_3)
shader_2 = ClusterOutput(shader)
col_2 = ClusterOutput(col)

# ==== cluster NormalizeType: Normalize a type for this document. This converts the length unit of the type to the length unit of this document and it scales the ports by the right scaling factor. Further it sorts the representations, ports, qualities by it's keys.
ty = ClusterInput()
ty_2 = Type(graft(ty))
typ = ModelType()  # -> Type, Valid, Name, Description, Icon, Variant, Unit, Representations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
typ_2 = ModelType(Type=ty_2)  # -> Type, Valid, Name, Description, Icon, Variant, Unit, Representations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
cnvunt = ConvertUnit(Value=1, FromUnit=typ_2.Unit, ToUnit=typ.Unit)
trim = TrimTree(Tree=typ_2.Ports, Depth=1)
trim_2 = TrimTree(Tree=typ_2.Representations, Depth=1)
trim_3 = TrimTree(Tree=typ_2.Qualities, Depth=1)
rep = ModelRepresentation(Representation=trim_2)  # -> Representation, Valid, Url, Mime, Lod, Tags
por = ModelPort(Port=trim)  # -> Port, Valid, Id, Point, Direction, Locators, Locators_2
qal = ModelQuality(Quality=trim_3)  # -> Quality, Valid, Name, Value, Unit, Definition
scale = Scale(Geometry=por.Point, Center=Point(0, 0, 0), Factor=cnvunt)  # -> Geometry, Transform
concat = Concatenate(FragmentA=rep.Mime, FragmentC="##", FragmentB=rep.Lod)
scale_2 = Scale(Geometry=por.Direction, Center=Point(0, 0, 0), Factor=cnvunt)  # -> Geometry, Transform
join = TextJoin(Text=rep.Tags, Join="##")
tsort = SortText(Keys=qal.Name, Values=qal.Quality, Culture=127)  # -> Keys, Values
por_2 = ModelPort(Port=por.Port, Point=scale.Geometry, Direction=scale_2.Geometry)  # -> Port, Valid, Id, Point, Direction, Locators, Locators_2
concat_2 = Concatenate(FragmentA=graft(concat), FragmentB=join)
trim_4 = TrimTree(Tree=tsort.Values, Depth=1)
trim_5 = TrimTree(Tree=concat_2, Depth=1)
tsort_2 = SortText(Keys=por_2.Id, Values=por_2.Port, Culture=127)  # -> Keys, Values
trim_6 = TrimTree(Tree=tsort_2.Values, Depth=1)
tsort_3 = SortText(Keys=trim_5, Values=rep.Representation, Culture=127)  # -> Keys, Values
trim_7 = TrimTree(Tree=tsort_3.Values, Depth=1)
typ_3 = ModelType(Type=typ_2.Type, Unit=typ.Unit, Representations=trim_7, Ports=trim_6, Qualities=trim_4)  # -> Type, Valid, Name, Description, Icon, Variant, Unit, Representations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
trim_8 = TrimTree(Tree=typ_3.Type, Depth=1)
ty_3 = Type(trim_8)
ty_4 = ClusterOutput(ty_3)

# ==== cluster SelectRepresentation: Select a representation based on mime, lod and tags. The mime and lod must be equal and the tags must contain all the given tags.
rp = ClusterInput()
mm = ClusterInput()
lod = ClusterInput()
tags = ClusterInput()
rp_2 = Representation(rp)
mm_2 = Mime(mm)
lod_2 = Lod(lod)
tags_2 = Tags(tags)
rep = ModelRepresentation(Representation=rp_2)  # -> Representation, Valid, Url, Mime, Lod, Tags
expression = Expression(x=rep.Mime, y=mm_2, Expression="x=y")
cull = CullPattern(List=rep.Representation, CullPattern=expression)
rep_2 = ModelRepresentation(Representation=cull)  # -> Representation, Valid, Url, Mime, Lod, Tags
expression_2 = Expression(x=rep_2.Lod, y=lod_2, Expression="x=y")
cull_2 = CullPattern(List=rep_2.Representation, CullPattern=expression_2)
rep_3 = ModelRepresentation(Representation=cull_2)  # -> Representation, Valid, Url, Mime, Lod, Tags
trim = TrimTree(Tree=rep_3.Tags, Depth=1)
contains = Contains(L=trim, I=tags_2)  # -> R; inputs L: list, I: list
# ---------- contains: Python ----------
#Component Information
#--------------------------------------------------------------------------------------------
if ghenv.Component.RunCount<2:
    #General
    #--------------------------------------------------------------------------------------------
    __author__ = "Ueli Saluz"
    __version__ = "2023.02.04"
    
    ghenv.Component.Name = "Contains"
    ghenv.Component.NickName = "Contains"
    ghenv.Component.Description = "True if list contains one of the items."
    ghenv.Component.Message = "VER 1.0"
    ghenv.Component.Category = "Set"
    ghenv.Component.SubCategory = "List"
    
     #Inputs
    #--------------------------------------------------------------------------------------------
    inputIndex=0
    
    ghenv.Component.Params.Input[inputIndex].Name = "List"
    ghenv.Component.Params.Input[inputIndex].NickName = "L"
    ghenv.Component.Params.Input[inputIndex].Description = ""
    ghenv.Component.Params.Input[inputIndex].Optional = False
    inputIndex+=1
    
    ghenv.Component.Params.Input[inputIndex].Name = "Items"
    ghenv.Component.Params.Input[inputIndex].NickName = "I"
    ghenv.Component.Params.Input[inputIndex].Description = ""
    ghenv.Component.Params.Input[inputIndex].Optional = False
    inputIndex+=1
    
    #Outputs
    #--------------------------------------------------------------------------------------------
    outputIndex=0
    
    ghenv.Component.Params.Output[outputIndex].Name = "Contains"
    ghenv.Component.Params.Output[outputIndex].NickName = "R"
    ghenv.Component.Params.Output[outputIndex].Description = ""
    outputIndex+=1

R = False
for i in I:
    if i in L:
        R = True
# ---------- end contains ----------
ma = MassAddition(Input=contains)  # -> Result, PartialResults
lng = ListLength(List=contains)
equals = Equality(FirstNumber=ma.Result, SecondNumber=lng)  # -> Equality, Inequality
cull_3 = CullPattern(List=rep_3.Representation, CullPattern=equals.Equality)
rep_4 = ModelRepresentation(Representation=cull_3)  # -> Representation, Valid, Url, Mime, Lod, Tags
curdir = CSharpScript()  # -> D, S
# ---------- curdir: C# ----------
#region Usings
using System;
using System.Linq;
using System.Collections;
using System.Collections.Generic;
using System.Drawing;
using System.IO;

using Rhino;
using Rhino.Geometry;

using Grasshopper;
using Grasshopper.Kernel;
using Grasshopper.Kernel.Data;
using Grasshopper.Kernel.Types;
#endregion

public class Script_Instance : GH_ScriptInstance
{
    private void RunScript(ref object D, ref object S)
    {
        D = Path.GetDirectoryName(this.GrasshopperDocument.FilePath);
        S = Path.DirectorySeparatorChar;
    }
}
# ---------- end curdir ----------
rep_5 = ReplaceText(Text=rep_4.Url, Find="/", Replace=curdir.S, RecursiveReplace=False)
rp_3 = Representation(rep_4.Representation)
pa_ur = Text(rep_5)
ur = Url(rep_4.Url)
rp_4 = ClusterOutput(rp_3)
ur_2 = ClusterOutput(ur)
pa_ur_2 = ClusterOutput(pa_ur)
